test file "HighwayLaneChangeMetricAssessments"
  coverage: Decision, MCDC, SignalRange, Condition

suite "Test Scenarios"

  case "scenario_LC_01_SlowMoving" [baseline]
    model HighwayLaneChangeTestBench
    post-load callback:
      helperSLHighwayLaneChangeSetup("scenarioFcnName","scenario_LC_01_SlowMoving");
    cleanup callback:
      helperLaneChangeReport(sltest_simout.logsout);

  case "scenario_LC_02_SlowMovingWithPassingCar" [baseline]
    model HighwayLaneChangeTestBench
    post-load callback:
      helperSLHighwayLaneChangeSetup("scenarioFcnName","scenario_LC_02_SlowMovingWithPassingCar");
    cleanup callback:
      helperLaneChangeReport(sltest_simout.logsout);

  case "scenario_LC_03_DisabledCar" [baseline]
    model HighwayLaneChangeTestBench
    post-load callback:
      helperSLHighwayLaneChangeSetup("scenarioFcnName","scenario_LC_03_DisabledCar");
    cleanup callback:
      helperLaneChangeReport(sltest_simout.logsout);

  case "scenario_LC_04_CutInWithBrake" [baseline]
    model HighwayLaneChangeTestBench
    post-load callback:
      helperSLHighwayLaneChangeSetup("scenarioFcnName","scenario_LC_04_CutInWithBrake");
    cleanup callback:
      helperLaneChangeReport(sltest_simout.logsout);

  case "scenario_LC_05_SingleLaneChange" [baseline]
    model HighwayLaneChangeTestBench
    post-load callback:
      helperSLHighwayLaneChangeSetup("scenarioFcnName","scenario_LC_05_SingleLaneChange");
    cleanup callback:
      helperLaneChangeReport(sltest_simout.logsout);

  case "scenario_LC_06_DoubleLaneChange" [baseline]
    model HighwayLaneChangeTestBench
    post-load callback:
      helperSLHighwayLaneChangeSetup("scenarioFcnName","scenario_LC_06_DoubleLaneChange");
    cleanup callback:
      helperLaneChangeReport(sltest_simout.logsout);

  case "scenario_LC_07_RightLaneChange" [baseline]
    model HighwayLaneChangeTestBench
    post-load callback:
      helperSLHighwayLaneChangeSetup("scenarioFcnName","scenario_LC_07_RightLaneChange");
    cleanup callback:
      helperLaneChangeReport(sltest_simout.logsout);

  case "scenario_LC_08_SlowmovingCar_Curved" [baseline]
    model HighwayLaneChangeTestBench
    post-load callback:
      helperSLHighwayLaneChangeSetup("scenarioFcnName","scenario_LC_08_SlowmovingCar_Curved");
    cleanup callback:
      helperLaneChangeReport(sltest_simout.logsout);

  case "scenario_LC_09_CutInWithBrake_Curved" [baseline]
    model HighwayLaneChangeTestBench
    post-load callback:
      helperSLHighwayLaneChangeSetup("scenarioFcnName","scenario_LC_09_CutInWithBrake_Curved");
    cleanup callback:
      helperLaneChangeReport(sltest_simout.logsout);

  case "scenario_LC_10_SingleLaneChange_Curved" [baseline]
    model HighwayLaneChangeTestBench
    post-load callback:
      helperSLHighwayLaneChangeSetup("scenarioFcnName","scenario_LC_10_SingleLaneChange_Curved");
    cleanup callback:
      helperLaneChangeReport(sltest_simout.logsout);

  case "scenario_LC_11_MergingCar_HighwayEntry" [baseline]
    model HighwayLaneChangeTestBench
    post-load callback:
      helperSLHighwayLaneChangeSetup("scenarioFcnName","scenario_LC_11_MergingCar_HighwayEntry");
    cleanup callback:
      helperLaneChangeReport(sltest_simout.logsout);

  case "scenario_LC_12_CutInCar_HighwayEntry" [baseline]
    model HighwayLaneChangeTestBench
    post-load callback:
      helperSLHighwayLaneChangeSetup("scenarioFcnName","scenario_LC_12_CutInCar_HighwayEntry");
    cleanup callback:
      helperLaneChangeReport(sltest_simout.logsout);

  case "scenario_LC_13_DisabledCar_Ushape" [baseline]
    model HighwayLaneChangeTestBench
    post-load callback:
      helperSLHighwayLaneChangeSetup("scenarioFcnName","scenario_LC_13_DisabledCar_Ushape");
    cleanup callback:
      helperLaneChangeReport(sltest_simout.logsout);

  case "scenario_LC_14_DoubleLaneChange_Ushape" [baseline]
    model HighwayLaneChangeTestBench
    post-load callback:
      helperSLHighwayLaneChangeSetup("scenarioFcnName","scenario_LC_14_DoubleLaneChange_Ushape");
    cleanup callback:
      helperLaneChangeReport(sltest_simout.logsout);

  case "scenario_LC_15_StopnGo_Curved" [baseline]
    model HighwayLaneChangeTestBench
    post-load callback:
      helperSLHighwayLaneChangeSetup("scenarioFcnName","scenario_LC_15_StopnGo_Curved");
    cleanup callback:
      % Plot the results
      helperLaneChangeReport(sltest_simout.logsout);