% Requirement links of HighwayLaneChangeMetricAssessments.mldatx (R2021a)

item 1 verifies HighwayLaneChangeTestRequirements.slreqx#15: scenario_LC_15_StopnGo_Curved
item 2 verifies HighwayLaneChangeTestRequirements.slreqx#2: scenario_LC_02_SlowMovingWithPassingCar
item 3 verifies HighwayLaneChangeTestRequirements.slreqx#14: scenario_LC_14_DoubleLaneChange_Ushape
item 4 verifies HighwayLaneChangeTestRequirements.slreqx#11: scenario_LC_11_MergingCar_HighwayEntry
item 5 verifies HighwayLaneChangeTestRequirements.slreqx#5: scenario_LC_05_SingleLaneChange
item 6 verifies HighwayLaneChangeTestRequirements.slreqx#7: scenario_LC_07_RightLaneChange
item 7 verifies HighwayLaneChangeTestRequirements.slreqx#6: scenario_LC_06_DoubleLaneChange
item 8 verifies HighwayLaneChangeTestRequirements.slreqx#4: scenario_LC_04_CutInWithBrake
item 9 verifies HighwayLaneChangeTestRequirements.slreqx#9: scenario_LC_09_CutInWithBrake_Curved
item 10 verifies HighwayLaneChangeTestRequirements.slreqx#13: scenario_LC_13_DisabledCar_Ushape
item 11 verifies HighwayLaneChangeTestRequirements.slreqx#8: scenario_LC_08_SlowmovingCar_Curved
item 12 verifies HighwayLaneChangeTestRequirements.slreqx#12: scenario_LC_12_CutInCar_HighwayEntry
item 13 verifies HighwayLaneChangeTestRequirements.slreqx#3: scenario_LC_03_DisabledCar
item 14 verifies HighwayLaneChangeTestRequirements.slreqx#1: scenario_LC_01_SlowMoving
item 15 verifies HighwayLaneChangeTestRequirements.slreqx#10: scenario_LC_10_SingleLaneChange_Curved